# Grasshopper definition demo.gh (Grasshopper 1.0.8)
# Copyright: favolab
# plug-ins: Boletus

pt = ConstructPoint(XCoordinate=0, YCoordinate=0, ZCoordinate=0)
number_slider = Slider(-33, range=-50..0)
rotate = Rotate(Angle=1.570796327, Plane=PlaneXY(0, 0, 0))  # -> Geometry, Transform
prim = Primitive(Type=Slider(3, range=0..10), A=pt, B=Point(1, 1, 1), N0=Slider(14.99, range=0..100), N1=Slider(3.96, range=0..100))
pt_2 = ConstructPoint(XCoordinate=number_slider, YCoordinate=number_slider, ZCoordinate=0)
pt_3 = ConstructPoint(XCoordinate=Slider(45.71, range=0..100), YCoordinate=Slider(28.61, range=0..100), ZCoordinate=Slider(6.1, range=0..100))
xform = Transform(Volume=prim, Transform=rotate.Transform)
prim_2 = Primitive(Type=Slider(0, range=0..10), A=pt_2, B=pt_3, N0=1, N1=0.25)
offset = Offset(Volume=prim, Distance=Slider(2.17, range=0..100))
rad = Radians(Degrees=Slider(3, range=0..100))
bend = Bend(Volume=xform, Curvature=rad, Axis=2)
rad_2 = Radians(Degrees=Slider(1.13, range=0..100))
X = UnitX(Factor=1)
twist = Twist(Volume=prim_2, Rate=rad_2, Axis=X)
offset_2 = Offset(Volume=bend, Distance=Slider(3.53, range=0..100))
displace = Displace(Volume=offset, Function=Slider(1, range=0..2), Amplitude=Slider(0.62, range=0..10), Frequency=Slider(1.1, range=0..10))
proxy = ProxyPreview(Volume=displace, Depth=6)
proxy_2 = ProxyPreview(Volume=offset_2, Depth=6)
proxy_3 = ProxyPreview(Volume=twist, Depth=9)
pt_4 = ConstructPoint(XCoordinate=0, YCoordinate=0, ZCoordinate=0)
prim_3 = Primitive(Type=Slider(1, range=0..10), A=pt_4, B=Point(1, 1, 1), N0=Slider(25.61, range=0..100), N1=0.25)
tpms = TPMS(Family=0, Wavelength=Slider(4.3, range=0.5..10))
proxy_4 = ProxyPreview(Volume=prim_3, Depth=9)
norm = Normalize(Volume=tpms)
onion = Onion(Volume=norm, Thickness=Slider(0.9, range=0..1), Boundary=prim_3)
livepreview = LivePreview(Volume=onion, On=Toggle(False))
number_slider_2 = Slider(0, range=0..100)  # disabled
number_slider_3 = Slider(8, range=0..10)  # disabled
number_slider_4 = Slider(0, range=0..100)  # disabled
panel = Panel("D:/cecioz")  # disabled
write = WriteToFile(Volume=onion, Depth=number_slider_3, Path=panel, Format=number_slider_2, Mode=number_slider_4)  # -> Info, File; disabled
panel_2 = Panel(write.Info)  # disabled
panel_3 = Panel(write.File)  # disabled
